vi "Main.Lab.gviweb"   [LabVIEW NXG 5.0.0]
panel controls:
  "Connecting Solar Panels": i32 = -1
  "Solar panel tilt angle, º": f64
  "Power setting for the light source, W": f64
  "Cooling conditions": i32 = -1
  "Clear/ Tab 1": bool
  "Isc": f64
  "Uoc": f64
  "Clear Graph Tab 4": bool
  "Save in memory": bool
  "Slot Name": string
  "Slot Number": i32 = "Slot 1"(0)
  "Imp": f64
  "Ump": f64
  "FF/Calculation": bool
  "Add to table Tab 4": bool
  "Calculate Tab 1": bool
  "T1": f64
  "T2": f64
  "Uoc/Calculation_3": f64
  "Uoc2": f64
  "Kt/Calculation": bool
  "Dimming conditions": i32 = -1
  "Parallel connection": i32 = -1
  "Series connection": i32 = -1
  "Heating conditions": i32 = -1
  "1х, Ohm": i32[]
  "10х": i32[]
  "100х": i32[]
  "Set Load": bool
  "Calculate average": bool
  "Parameter Y": i32 = -1
  "Parameter X": i32 = -1
  "Calculation": i32
  "1000х": i32[]
  "History Graph V/Measurment": i16 = 400
  "History Graph I/Measurment": i16 = 400
  "History Graph T/Measurment": i16 = 400
  "Clear All Memory": bool
  "Clear Table Tab 4": bool
  "Slot number/Read/": i32 = "1"(0)
  "Manual/Automatic": enum{"Manual", "Automatic"} = "Manual"
  "Show Graph Tab 4": bool
  "Clear Memory": bool
  "Slot number Tab 1": i32 = "1"(0)
  "Calc/Slot number2.1": i32 = "1"(0)
  "Show / Hide Graph 1": bool
  "Delete Last Tab 4": bool
  "Change History J/Measurment": i32
  "History Graph R/Measurment": i16 = 400
  "History Graph J/Measurment": i16 = 400
  "Show / Hide Graph 2": bool
  "Calc/Slot number2.2": i32 = "1"(0)
  "Calc/Slot number2.3": i32 = "1"(0)
  "Calc/Slot number2.4": i32 = "1"(0)
  "Show / Hide Graph 3": bool
  "Show / Hide Graph 4": bool
  "Input Data": f64[][] = [[1.814, 0.0233, 27.1, 0, 500, 70], [1.802, 0.069, 26.11, 0, 500, 75], [1.794, 0.109, 16.45, 0, 500, 73], [1.792, 0.151, 11.86, 0, 500, 72], [1.78, 0.192, 9.27, 0, 500, 73], [1.773, 0.231, 7.5, 0, 500, 0], [1.765, 0.273, 6.46, 0, 500, 0], [1.762, 0.315, 5.59, 0, 500, 0], [1.754, 0.358, 4.89, 0, 500, 0], [1.734, 0.399, 4.34, 0, 500, 0], [1.725, 0.439, 3.78, 0, 500, 0], [1.721, 0.48, 3.54, 0, 500, 0], [1.711, 0.521, 3.15, 0, 500, 0], [1.688, 0.561, 3.01, 0, 500, 0], [1.667, 0.602, 2.7, 0, 500, 0], [1.657, 0.636, 2.59, 0, 500, 0], [1.648, 0.678, 2.32, 0, 500, 0], [1.613, 0.718, 2.1, 0, 500, 0], [1.244, 0.761, 1.64, 0, 500, 0], [0.461, 0.793, 0.58, 0, 500, 0], [0.016, 0.798, 0.02, 0, 500, 0]]
  "X": f64
  "Y": f64
  "Stop": bool
  "error in": error
  "error in_2": error
  "Stop_2": bool
  "error in_4": error
  "value": f64
  "error in_6": error
  "Stop_3": bool
  "error in_5": error
panel indicators:
  "Start/Stop lab": bool
  "Refresh": bool
  "Lab Manual": bool
  "Graph Voltage": f64[]
  "Clear Graph V/Measurment": bool
  "Change history V/Measurment": bool
  "Isc/Calculation": bool
  "Uoc/Calculation": bool
  "Graph Tab 4": cluster{"Element 1": f64[], "Element 2": f64[]}
  "Print Page": bool
  "Slot name": string
  "Imp/Calculation": bool
  "Ump/Calculation": bool
  "FF": f64
  "Graph 1 Tab 3": T1[]
  "Graph 2 Tab 3": cluster{"Element 1": f64[], "Element 2": f64[]}[]
  "T1/Calclation": bool
  "T2/Calculation": bool
  "Uoc1/Calculation": bool
  "Uoc2/Calculation": bool
  "Kt": f64
  "Total Load, Ohm": i32
  "URL Image_2": string
  "URL Image_3": string
  "Graph Current": f64[]
  "Clear Graph I/Measurment": bool
  "Graph Temperature": f64[]
  "Clear Graph T/Measurment": bool
  "Change History I/Measurment": bool
  "Change History T/Measurment": bool
  "URL Image_4": string
  "Memory Slot": string[]
  "Read Slot Name": string
  "URL Image_5": string
  "LED": bool
  "button_38": bool
  "Table/Measurment": f64[][]
  "URL Image_6": string
  "URL Image_7": string
  "Graph Tab 1": T1[]
  "Web Camera": string
  "Temperature, ºC": f64
  "Delete Last": bool
  "Slot name2.1": string
  "Slot name2.2": string
  "Slot name2.3": string
  "Update Display": string
  "Graph Load": f64[]
  "Clear Graph R/Measurment": bool
  "Change History R/Measurment": bool
  "Graph_10": f64[]
  "Clear Graph J/Measurment": bool
  "Change History J/Measurment_2": bool
  "Table Measurments": f64[][]
  "Headers/Calculation": string[]
  "Slot name2.4": string
  "Headers/Measurment": string[]
  "Intensity, W/m2": f64
  "Panel tilt angle, º": f64
  "Angle of rotation 1, º": f64
  "Angle of rotation 1, º_2": f64
  "Table/Avarage": f64[][]
  "Table Tab 4": f64[][]
  "Header XY": string[]
  "Table Tab 4_2": f64[][]
  "error out": error
  "error out_2": error
  "error out_4": error
  "error out_3": error
  "value_2": f64
  "error out_6": error
types:
  T1 = cluster{"Element 1": cluster{"Element 1": f64, "Element 2": f64}[]}
uses:
  NI::Skyline::Configuration::Open Configuration API Key.gvi
  NI::Skyline::TagHTTP::Open Tag.gvi
  NI::Skyline::TagHTTP::Write Tag (DBL).gvi
  NI::Skyline::TagHTTP::Close Tag (Single).gvi
  NI::Skyline::Configuration::Close Configuration.gvi
  NI::Skyline::TagHTTP::Query Tags.gvi
  NI::Skyline::TagHTTP::Read Tag (DBL).gvi
  NI::Skyline::Configuration::Open Configuration.gvi
  NI::Skyline::MessageHTTP::Open.gvi
  NI::Skyline::MessageHTTP::Publish.gvi
  NI::Skyline::MessageHTTP::Flush.gvi
  NI::Skyline::MessageHTTP::Subscribe.gvi
  NI::Skyline::MessageHTTP::Read.gvi
  NI::Skyline::MessageHTTP::Unsubscribe.gvi
  WebApp::Support::Message Queue::Create All Message Queues.gvi
  WebApp::Support::Message Queue::Enqueue Message (Single).gvi
  WebApp::Support::Message Queue::Dequeue Message.gvi
  WebApp::Memory Buffer::Memory buffer.gvi
  WebApp::Custom Chart::Custom Chart.gvi
  WebApp::Load Selection::Load selection.gvi
diagram:
  while {
    Wait(time to wait=200)
    call "Open Configuration API Key.gvi"(server url="https://api.systemlinkcloud.com/", api key="zYUbuW0YNkg1G__lXfJiGVBNWME-HlVd2a5NUHp-IP", error in=$"error in_4") -> (configuration=w1, error out=w2)
    call "Open Tag.gvi"(path="d", data type="Double", error in=w2, configuration=w1) -> (tag=w3, error out=w4)
    while {
      call "Write Tag (DBL).gvi"(tag in=w3, value=$value, error in=w4) -> (tag out=w5, error out=w6)
      stop if $Stop_2
    }
    call "Close Tag (Single).gvi"(tag=w5, error in=w6) -> (error out=w7)
    call "Close Configuration.gvi"(configuration=w1, error in=w7) -> (error out=w8)
    $"error out_4" <- w8
    call "Open Configuration API Key.gvi"(server url="https://api.systemlinkcloud.com/", api key="zYUbuW0YNkg1G__lXfJiGVBNWME-HlVd2a5NUHp-IP", error in=$"error in_2") -> (configuration=w9, error out=w10)
    call "Query Tags.gvi"(paths=["PV-TT", "PV-IT", "PV-AT"], error in=w10, configuration=w9) -> (tags=w11, error out=w12)
    for {
      w13 = each element of w11
      Wait(time to wait=400)
      Property Node(instance in=w13) -> ("Path"=w15, "Datatype"=w16)
      call "Open Tag.gvi"(path=w15, data type=w16, error in=w12, configuration=w9) -> (tag=w17, error out=w18)
      call "Read Tag (DBL).gvi"(tag in=w17, error in=w18) -> (tag out=w19, value=w20, error out=w21)
      append w20 to w14
    }
    call "Close Tag (Single).gvi"(tag=w19, error in=w21) -> (error out=w22)
    call "Close Configuration.gvi"(configuration=w9, error in=w22) -> (error out=w23)
    $"error out_2" <- w23
    Array Index(array=w14) -> (out0[_]=w24, out1[_]=w25, out2[_]=w26)
    $"Temperature, ºC" <- w24
    $"Intensity, W/m2" <- w25
    $"Panel tilt angle, º" <- w26
    call "Open Configuration API Key.gvi"(server url="https://api.systemlinkcloud.com/", api key="zYUbuW0YNkg1G__lXfJiGVBNWME-HlVd2a5NUHp-IP", error in=$"error in_5") -> (configuration=w27, error out=w28)
    call "Open Tag.gvi"(path="d3", data type="Double", error in=w28, configuration=w27) -> (tag=w29, error out=w30)
    while {
      call "Read Tag (DBL).gvi"(tag in=w29, error in=w30) -> (tag out=w31, value=w32, error out=w33)
      $value_2 <- w32
      stop if $Stop_3
    }
    call "Close Tag (Single).gvi"(tag=w31, error in=w33) -> (error out=w34)
    call "Close Configuration.gvi"(configuration=w27, error in=w34) -> (error out=w35)
    $"error out_6" <- w35
    stop if FALSE
  }
  disable {
    frame Enabled { }
    frame Disabled {
      call "Open Configuration API Key.gvi"(server url="", api key="", error in=$"error in_6") -> (configuration=w36)
      Build Array($"Solar panel tilt angle, º", $"Power setting for the light source, W") -> w37
      for {
        w38 = each element of ["MV-AT", "MV-IT", ""]
        w39 = each element of w37
        Wait(time to wait=200)
        call "Open Tag.gvi"(path=w38, data type="Double", configuration=w36) -> (tag=w40)
        call "Write Tag (DBL).gvi"(tag in=w40, value=w39) -> (tag out=w41, error out=w42)
      }
      call "Close Tag (Single).gvi"(tag=w41, error in=w42) -> (error out=w43)
      call "Close Configuration.gvi"(configuration=w36, error in=w43) -> (error out=w44)
      $"error out_3" <- w44
    }
  }
  disable {
    frame Enabled { }
    frame Disabled {
      sequence {
        frame 0 {
          call "Open Configuration.gvi"(server url="http://localhost:80/", username="admin", password="password") -> (configuration=w45, error out=w46)
          call "Open.gvi"(error in=w46, configuration=w45) -> (message session=w47, error out=w48)
        }
        frame 1 {
          s1 = w47  # shift register
          s2 = w48  # shift register
          while {
            call "Publish.gvi"(message session in=s1, topic="TopicName", message="New Message\n..................\n..................", error in=s2) -> (message session out=w49, error out=w50)
            next s1 = w49
            next s2 = w50
            stop if FALSE
          }
        }
        frame 2 {
          call "Flush.gvi"(message session in=s1, error in=s2) -> (error out=w51)
          call "Close Configuration.gvi"(configuration=w45, error in=w51)
        }
      }
      sequence {
        frame 0 {
          call "Open Configuration.gvi"(server url="http://localhost:80/", username="admin", password="password") -> (configuration=w52, error out=w53)
          call "Open.gvi"(error in=w53, configuration=w52) -> (message session=w54, error out=w55)
        }
        frame 1 {
          call "Subscribe.gvi"(message session in=w54, topic="TopicName", error in=w55) -> (message session out=w56, error out=w57)
        }
        frame 2 {
          s3 = w56  # shift register
          s4 = w57  # shift register
          while {
            call "Read.gvi"(message session in=s3, error in=s4) -> (message session out=w58, topic=w59, message=w60, error out=w61)
            sequence (after w59) (after w60) {
              frame 0 { }
            }
            next s3 = w58
            next s4 = w61
            stop if FALSE
          }
        }
        frame 3 {
          call "Unsubscribe.gvi"(message session in=s3, topic="TopicName", error in=s4) -> (message session out=w62, error out=w63)
        }
        frame 4 {
          call "Flush.gvi"(message session in=w62, error in=w63) -> (error out=w64)
          call "Close Configuration.gvi"(configuration=w52, error in=w64)
        }
      }
      call "Open Configuration.gvi"(server url="", username="admin", password="test", error in=$"error in") -> (configuration=w65, error out=w66)
      call "Open Tag.gvi"(path="", data type="Double", error in=w66, configuration=w65) -> (tag=w67, error out=w68)
      while {
        call "Write Tag (DBL).gvi"(tag in=w67, value=0, error in=w68) -> (tag out=w69, error out=w70)
        stop if $Stop
      }
      call "Close Tag (Single).gvi"(tag=w69, error in=w70) -> (error out=w71)
      call "Close Configuration.gvi"(configuration=w65, error in=w71) -> (error out=w72)
      $"error out" <- w72
    }
  }
  call "Create All Message Queues.gvi"() -> (message queue=w73, error out=w74)
  while {
    event {
      on "Save in memory" Value changed {
        w75 = "Measurements/Save in Memory Buffer"  # Buttons WebVI
        call "Enqueue Message (Single).gvi"(message queue in=w73, message="", Enum=w75)
      }
      on "Slot number/Read/" Value changed {
        w76 = "Measurements/Read from Memory Buffer"  # Buttons WebVI
        call "Enqueue Message (Single).gvi"(message queue in=w73, message="", Enum=w76)
      }
      on "Clear Memory" Value changed {
        w77 = "Memory Buffer/Clear"  # Buttons WebVI
        call "Enqueue Message (Single).gvi"(message queue in=w73, message="", Enum=w77)
      }
      on "Clear All Memory" Value changed {
        w78 = "Memory Buffer/Clear all"  # Buttons WebVI
        call "Enqueue Message (Single).gvi"(message queue in=w73, message="", Enum=w78)
      }
      on "1000х" Value changed; "100х" Value changed; "10х" Value changed; "1х, Ohm" Value changed; "Manual/Automatic" Value changed {
        w79 = "Load Selection"  # Buttons WebVI/Measurments
        call "Enqueue Message (Single).gvi"(message queue in=w73, message="", Enum=w79)
      }
      on "Set Load" Value changed { }
      on "Slot number Tab 1" Value changed {
        w80 = "Calculations/Read Slot Memory"  # Buttons WebVI/Measurments
        call "Enqueue Message (Single).gvi"(message queue in=w73, message="", Enum=w80)
      }
      on "Calculate Tab 1" Value changed {
        w81 = "Calculation/Tab 1"  # Buttons WebVI/Measurments
        call "Enqueue Message (Single).gvi"(message queue in=w73, message="", Enum=w81)
      }
      on "Clear/ Tab 1" Value changed {
        w82 = "Clear/Tab 1"  # Buttons WebVI/Measurments
        call "Enqueue Message (Single).gvi"(message queue in=w73, message="", Enum=w82)
      }
      on "Calc/Slot number2.1" Value changed; "Calc/Slot number2.2" Value changed; "Calc/Slot number2.3" Value changed; "Calc/Slot number2.4" Value changed; "Show / Hide Graph 1" Value changed; "Show / Hide Graph 2" Value changed; "Show / Hide Graph 3" Value changed; "Show / Hide Graph 4" Value changed {
        w83 = "Calculation/Tab 2"  # Buttons WebVI/Measurments
        call "Enqueue Message (Single).gvi"(message queue in=w73, message="", Enum=w83)
      }
      on "Add to table Tab 4" Value changed {
        w84 = "Create Table/Tab 3"  # Buttons WebVI
        call "Enqueue Message (Single).gvi"(message queue in=w73, message="", Enum=w84)
      }
      on "Clear Table Tab 4" Value changed {
        w85 = "Clear Table/Tab 3"  # Buttons WebVI
        call "Enqueue Message (Single).gvi"(message queue in=w73, message="", Enum=w85)
      }
      on "Delete Last Tab 4" Value changed {
        w86 = "Delete Last Table/Tab 3"  # Buttons WebVI
        call "Enqueue Message (Single).gvi"(message queue in=w73, message="", Enum=w86)
      }
      on "Show Graph Tab 4" Value changed {
        call "Enqueue Message (Single).gvi"(message queue in=w73, message="", Enum="Show Chart")
      }
      on "Clear Graph Tab 4" Value changed {
        w87 = "Clear Chart"  # Buttons WebVI
        call "Enqueue Message (Single).gvi"(message queue in=w73, message="", Enum=w87)
      }
      on "Parameter X" Value changed; "Parameter Y" Value changed {
        w88 = "Header Tab 3"  # Buttons WebVI
        call "Enqueue Message (Single).gvi"(message queue in=w73, message="", Enum=w88)
      }
    }
    stop if FALSE
  }
  while {
    call "Dequeue Message.gvi"(message queue in=w73, error in=w74) -> (message queue out=w89, message=w90, Enum=w91)
    case (w91) {
      frame "Initialize ", Default {
        call "Memory buffer.gvi"(Initialize/Max Number of slots memory=10, Command to buffer="Initialize") -> (Slot name indicator=w92)
        $"Memory Slot" <- w92
        w93 = "Initialize"  # Command Chart
        call "Custom Chart.gvi"(Command Graph=w93, X=0, Y=0) -> (Table out=w94, Chart=w95)
        $"Table Tab 4" <- w94
        Property Node(instance in=reference to "Slot number Tab 1", "Value"=10)
        $"Graph Tab 4" <- w95
        Property Node(instance in=reference to "Table/Measurment", "Value"=f64[][] [])
        Property Node(instance in=reference to "Slot name", "Value"="")
        Property Node(instance in=reference to "Graph Tab 1", "Value"=T1[] [])
        w96 = ["U, V", "I, A", "R, Ohm", "Angle, º", "J, W / m²", "T, ºC", "P,W", "ɳ,%"]
        $"Headers/Measurment" <- w96
        $"Headers/Calculation" <- w96
        Property Node(instance in=reference to "Table Measurments", "Value"=f64[][] [])
        w97 = "Update Display"  # Buttons WebVI
        call "Enqueue Message (Single).gvi"(message queue in=w89, message="Initialize", Enum=w97)
      }
      frame "Measurements/Save in Memory Buffer" {
        call "Memory buffer.gvi"(Number of slot=$"Slot Number", Command to buffer="Read") -> (Read/Slot=w98)
        Property Node(instance in=w98, "Slot name"=$"Slot Name", "Measurements"=$"Input Data") -> (instance out=w99)
        w100 = "Write"  # Command
        call "Memory buffer.gvi"(Buffer Data=w99, Number of slot=$"Slot Number", Command to buffer=w100) -> (Slot name indicator=w101, Read/Slot=w102)
        $"Memory Slot" <- w101
        Property Node(instance in=w102) -> ("Measurements"=w103)
        $"Table/Measurment" <- w103
        w104 = "Update Display"  # Buttons WebVI
        call "Enqueue Message (Single).gvi"(message queue in=w89, message="Data recording", Enum=w104)
      }
      frame "Measurements/Read from Memory Buffer" {
        w105 = "Read"  # Command
        call "Memory buffer.gvi"(Number of slot=$"Slot number/Read/", Command to buffer=w105) -> (Slot name indicator=w106, Read/Slot=w107)
        $"Memory Slot" <- w106
        Property Node(instance in=w107) -> ("Slot name"=w108, "Measurements"=w109)
        $"Read Slot Name" <- w108
        $"Table/Measurment" <- w109
        w110 = "Update Display"  # Buttons WebVI
        call "Enqueue Message (Single).gvi"(message queue in=w89, message="Reading From Memory Buffer", Enum=w110)
      }
      frame "Memory Buffer/Clear" {
        w111 = "Clear"  # Command
        call "Memory buffer.gvi"(Number of slot=$"Slot number/Read/", Command to buffer=w111) -> (Slot name indicator=w112, Read/Slot=w113)
        $"Memory Slot" <- w112
        Property Node(instance in=w113) -> ("Slot name"=w114, "Measurements"=w115)
        $"Read Slot Name" <- w114
        $"Table/Measurment" <- w115
        w116 = "Update Display"  # Buttons WebVI
        call "Enqueue Message (Single).gvi"(message queue in=w89, message="Deleting memory", Enum=w116)
      }
      frame "Memory Buffer/Clear all" {
        w117 = "Clear all"  # Command
        call "Memory buffer.gvi"(Number of slot=$"Slot number/Read/", Command to buffer=w117) -> (Slot name indicator=w118, Read/Slot=w119)
        $"Memory Slot" <- w118
        Property Node(instance in=w119) -> ("Slot name"=w120, "Measurements"=w121)
        $"Read Slot Name" <- w120
        $"Table/Measurment" <- w121
        w122 = "Update Display"  # Buttons WebVI
        call "Enqueue Message (Single).gvi"(message queue in=w89, message="Deleting all memory", Enum=w122)
      }
      frame "Load Selection" {
        case ($"Manual/Automatic") {
          frame "Manual", Default {
            Property Node(instance in=reference to "1000х", "Disabled"=FALSE)
            Property Node(instance in=reference to "100х", "Disabled"=FALSE)
            call "Load selection.gvi"(List box=reference to "100х", Value=[100, 200, 400, 500]) -> (Sum=w123)
            Property Node(instance in=reference to "10х", "Disabled"=FALSE) -> (instance out=w124)
            call "Load selection.gvi"(List box=w124, Value=[10, 20, 40, 50]) -> (Sum=w125)
            call "Load selection.gvi"(List box=reference to "1х, Ohm", Value=[1, 2, 4, 5]) -> (Sum=w126)
            call "Load selection.gvi"(List box=reference to "1000х", Value=[1000, 2000, 3000]) -> (Sum=w127)
            Add(w127, w123, w125, w126) -> w128
            $"Total Load, Ohm" <- w128
            Property Node(instance in=reference to "Set Load", "Disabled"=FALSE)
            Property Node(instance in=reference to "1х, Ohm", "Disabled"=FALSE)
            Property Node(instance in=reference to "Total Load, Ohm", "Disabled"=FALSE)
          }
          frame "Automatic" {
            Property Node(instance in=reference to "1000х", "Disabled"=TRUE)
            Property Node(instance in=reference to "100х", "Disabled"=TRUE)
            Property Node(instance in=reference to "10х", "Disabled"=TRUE)
            Property Node(instance in=reference to "Set Load", "Disabled"=TRUE)
            Property Node(instance in=reference to "1х, Ohm", "Disabled"=TRUE)
            Property Node(instance in=reference to "Total Load, Ohm", "Disabled"=TRUE)
          }
        }
        w129 = "Update Display"  # Buttons WebVI
        call "Enqueue Message (Single).gvi"(message queue in=w89, message="Load selection", Enum=w129)
      }
      frame "Set Load" { }
      frame "Calculations/Read Slot Memory" {
        w130 = "Read"  # Command
        call "Memory buffer.gvi"(Number of slot=$"Slot number Tab 1", Command to buffer=w130) -> (Read/Slot=w131)
        Property Node(instance in=w131) -> ("Slot name"=w132, "Measurements"=w133)
        $"Slot name" <- w132
        $"Table Measurments" <- w133
        w134 = "Update Display"  # Buttons WebVI
        call "Enqueue Message (Single).gvi"(message queue in=w89, message="Buffer memory-Tab1", Enum=w134)
      }
      frame "Calculation/Tab 1" {
        w135 = "Read"  # Command
        call "Memory buffer.gvi"(Number of slot=$"Slot number Tab 1", Command to buffer=w135) -> (Read/Slot=w136)
        Property Node(instance in=w136) -> ("Measurements"=w137)
        Array Index(array=w137) -> (out0[_, 0]=w138, out1[_, 1]=w139, out2[_, 4]=w140)
        Build Index And Bundle Cluster Array(w138, w139) -> (out=w141)
        Multiply(w138, w139) -> w142
        Build Index And Bundle Cluster Array(w138, w142) -> (out=w143)
        Build Cluster Array(w141, w143) -> (out=w144)
        $"Graph Tab 1" <- w144
        w145 = "Write"  # Command
        w146 = "Read"  # Command
        call "Memory buffer.gvi"(Number of slot=$"Slot number Tab 1", Command to buffer=w146) -> (Read/Slot=w147)
        w148 = 0.025  # Square Solar Panel
        Multiply(w140, w148) -> w149
        Divide(x=w142, y=w149) -> w150
        Multiply(w150, 100) -> w151
        Build Array(w142, w151) -> w152
        Transpose 2D Array(2D array=w152) -> (transposed array=w153)
        Property Node(instance in=w147, "Calculations "=w153) -> (instance out=w154)
        call "Memory buffer.gvi"(Buffer Data=w154, Number of slot=$"Slot number Tab 1", Command to buffer=w145) -> (Read/Slot=w155)
        call "Memory buffer.gvi"(Buffer Data=w155, Number of slot=$"Slot number Tab 1", Command to buffer="Read") -> (Read/Slot=w156)
        Property Node(instance in=w156) -> ("Measurements"=w157, "Calculations "=w158)
        Insert Into Array(inArray=w157, index1=6, new=w158) -> w159
        $"Table Measurments" <- w159
        w160 = "Update Display"  # Buttons WebVI
        call "Enqueue Message (Single).gvi"(message queue in=w89, message="Calculate Tab 1", Enum=w160)
      }
      frame "Clear/Tab 1" {
        Property Node(instance in=reference to "Graph Tab 1", "Value"=T1[] [])
        Property Node(instance in=reference to "Table Measurments", "Value"=f64[][] [])
        w161 = "Update Display"  # Buttons WebVI
        call "Enqueue Message (Single).gvi"(message queue in=w89, message="Clear Graph Tab 1", Enum=w161)
      }
      frame "Calculation/Tab 2" {
        Build Array($"Calc/Slot number2.1", $"Calc/Slot number2.2", $"Calc/Slot number2.3", $"Calc/Slot number2.4") -> w162
        Build Array($"Show / Hide Graph 1", $"Show / Hide Graph 2", $"Show / Hide Graph 3", $"Show / Hide Graph 4") -> w163
        for {
          w164 = each element of w163
          w165 = each element of w162
          case (w164) {
            frame False, Default {
              w172 = cluster{"Element 1": f64[], "Element 2": f64[]} {all zero or empty}
              w169 = default
              w170 = T1[] []
              w171 = w172
            }
            frame True {
              w173 = "Read"  # Command
              call "Memory buffer.gvi"(Number of slot=w165, Command to buffer=w173) -> (Read/Slot=w174)
              Property Node(instance in=w174) -> (instance out=w175)
              Property Node(instance in=w175) -> ("Measurements"=w176, "Calculations "=w177, "Slot name"=w169)
              Array Index(array=w176) -> (out0[_, 0]=w178, out1[_, 1]=w179, out2[_, 2]=w180)
              Build Index And Bundle Cluster Array(w178, w179) -> (out=w181)
              Array Index(array=w177) -> (out0[_, 0]=w182, out1[_, 1]=w183)
              Build Index And Bundle Cluster Array(w178, w182) -> (out=w184)
              Build Cluster Array(w181, w184) -> (out=w170)
              Build Cluster(w180, w183) -> w171
            }
          }
          append w169 to w166
          concatenate w170 onto w167
          append w171 to w168
        }
        $"Graph 1 Tab 3" <- w167
        Array Index(array=w166) -> (out0[_]=w185, out1[_]=w186, out2[_]=w187, out3[_]=w188)
        $"Slot name2.1" <- w185
        $"Slot name2.2" <- w186
        $"Slot name2.3" <- w187
        $"Slot name2.4" <- w188
        $"Graph 2 Tab 3" <- w168
        w189 = "Update Display"  # Buttons WebVI
        call "Enqueue Message (Single).gvi"(message queue in=w89, message="Calculation Tab 2", Enum=w189)
      }
      frame "Header Tab 3" {
        Property Node(instance in=reference to "Parameter X") -> ("Items"=w190, "Value"=w191)
        Array Index(array=w190) -> (out0[w191]=w192)
        Property Node(instance in=reference to "Parameter Y") -> ("Items"=w193, "Value"=w194)
        Array Index(array=w193) -> (out0[w194]=w195)
        Build Array(w192, w195) -> w196
        $"Header XY" <- w196
      }
      frame "Create Table/Tab 3" {
        w197 = "Write/Read "  # Command Chart
        call "Custom Chart.gvi"(Command Graph=w197, X=$X, Y=$Y) -> (Table out=w198)
        $"Table Tab 4" <- w198
        w199 = "Update Display"  # Buttons WebVI
        call "Enqueue Message (Single).gvi"(message queue in=w89, message="Crate Table Tab 3", Enum=w199)
      }
      frame "Clear Table/Tab 3" {
        w200 = "Clear Table"  # Command Chart
        call "Custom Chart.gvi"(Command Graph=w200, X=$X, Y=$Y) -> (Table out=w201)
        $"Table Tab 4_2" <- w201
      }
      frame "Delete Last Table/Tab 3" {
        w202 = "Delete last"  # Command Chart
        call "Custom Chart.gvi"(Command Graph=w202, X=$X, Y=$Y) -> (Table out=w203)
        $"Table Tab 4" <- w203
      }
      frame "Show Chart" {
        call "Custom Chart.gvi"(Command Graph="Graph", X=$X, Y=$Y) -> (Chart=w204)
        $"Graph Tab 4" <- w204
      }
      frame "Clear Chart" {
        w205 = "Clear Chart"  # Command Chart
        call "Custom Chart.gvi"(Command Graph=w205, X=$X, Y=$Y) -> (Chart=w206)
        $"Graph Tab 4" <- w206
      }
      frame "Update Display" {
        $"Update Display" <- w90
      }
    }
    stop if FALSE
  }
